# Grasshopper definition LARGERslicer - Head (Ginger One, non-planar).gh (Grasshopper 1.0.9)
# plug-ins: LARGERslicer

# ---- group: 01. PART AND PRINT SETTINGS
# LARGER.slicer
# HEAD  -  GINGER ADDITIVE · GINGER ONE (MARLIN), NON-PLANAR SPIRAL
# The head of the 2024 print 'UNIKAT HEAD V2', rebuilt with the slicer components
# INSTRUCTIONS: INSTRUCTIONS
# 
# 1  'Head' is the NurbsHead model, 1.75 x its size (174 mm high), cut flat at the neck and placed at X 310, Y 278 on the 1000 x 1000 mm bed, as in the 2024 print. For your own part: replace 'Head' (in mm, standing on Z 0).
# 
# 2  Print Settings: bead 4 mm, layer 1.75 mm, first layer 0.9 mm, 11 mm/s, travel 166.7 mm/s (F10000), Min Speed 1 mm/s.
# 
# 3  Slice, Guide Mode 'Follow the part': the layers follow the wall from the neck to the crown, the nozzle stays vertical. One wall, printed as one spiral (Continuous Path, Mode Spiral). Min Layer Time 35 s: laps that would be faster are printed slower, as in 2024.
# 
# 4  Start and End: skirt, a brim of 6 beads, exit move.
# 
# 5  Read Path Check and Non-Planar Check (see the notes on the overhang). Move 'Pose' to see the printer head on the path.
# 
# 6  Click 'Save G-code' on Machine G-code. The file goes to the Desktop (GIN_..._Head_...gcode).
# 
# Extrusion: E = 0.21 x bead width x bead height x length (Ginger handbook, PLA virgin, all nozzles). Other materials: Extrusion Factor on Machine - PLA (Caldara) 0.7, PET-G 0.5, PLA foam 0.25, EVA + cork 3.4. Check the factor with a test wall and Material Factor (05).
# Cooling: the Ginger start code runs the fan at 0 % on layers 1 to 4 and writes M106 S153 (60 %) after layer 4. Use 100 % for heavy overhangs.
# 01. PART AND PRINT SETTINGS
# The head and the values of the 2024 print: bead 4 mm, layer 1.75 mm, first layer 0.9 mm, 11 mm/s.
head = Brep(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)
printset = PrintSettings(
    BeadWidth=4,
    LayerHeight=1.75,
    Speed=11,
    Flow=1,
    Overlap=0.15,
    MinRadius=0,
    Resolution=2,
    FilamentDiameter=0,
    MinSpeed=1,
    MaxSpeed=166.6666667,
    Preview=False,
    Density=1.25,
    FirstLayerHeight=0.9,
    Nozzle=0,
    SpeedMmS=True)

# ---- group: 02. SLICE ALONG THE PART, ONE SPIRAL
# 02. SLICE ALONG THE PART, ONE SPIRAL
# Layers follow the wall of the part, the nozzle stays vertical. One wall, spiral, Min Layer Time 35 s, then skirt, brim and exit.
# NOTES: WHERE THE NUMBERS COME FROM
# 
# Owner's definition 'head test unikat.gh' (2024): head mesh contoured every 2 mm from the crown, spiral (Spiral V3), bead 4 mm ('layer thickness'), per-point bead height from the distance to the layer below with an overhang correction, first layer 0.7 mm at F1500, layer time 35 s (40 s for the smallest laps), factor 'marlin 0.21, klipper 1' = 0.21, flow 80 %, max 330 mm3/s, travel F10000, rPETG, bed 90 C, three heads in a row.
# 
# G-code 'UntitledUNIKAT HEAD V2' (July 2024, regenerated unchanged in November 2024) - this example:
#   layers: 128 - 132
#   Z: 0.9 to 178.0 - 0.8 to 173.9 mm
#   Z span within one lap: up to 18.7 - up to 24 mm (both non-planar)
#   path: 36.7 - 41.2 m (skirt and brim included)
#   E total: 48353 - 47845
#   E/mm: 0.86 / 1.41 / 1.57 - 0.50 / 1.27 / 1.57 (5 % / median / 95 %)
#   F walls: 337 to 664 - 397 to 660 mm/min
#   first layer: F1500 at Z 0.9 - F660 (no separate first-layer speed)
#   crown: closes to r 0.6 mm - ends at r 6 mm, bead fading
#   time: about 81 - 83 min
# 
# Overhang: at this size the wall leans up to 64 degrees under chin and nose. Path Check reports 24 points more than half a bead beside the layer below; Non-Planar Check reports head collisions (tip 4 mm on tilted layers, layers 23 to 39). Both are shown as they are. A lower layer (1.38 to 1.5 mm) clears Path Check but gives more head collisions.
# 
# E conventions on the same Marlin firmware: this file uses the Grasshopper factor 0.21 (handbook). The OrcaSlicer test of July 2024 ('NurbsHead Test', 3 mm vase mode) used a virtual filament of 1.13 mm with flow 0.98: about 4.9 x the E of the handbook value for slicers (2.5 mm filament). Trust the handbook and calibrate with Material Factor.
slice = Slice(Geometry=head, Settings=printset, Plane=PlaneXY(0, 0, 0), Angle=0, GuideMode=2, ToolAxis=1, StartEndLayers=0)  # -> Layers, Contours, Info
walls = Walls(Layers=slice.Layers, Settings=printset, Count=1, Position=0)  # -> Layers, Contours, Info
contpath = ContinuousPath(Layers=walls.Layers, Settings=printset, Mode=0, SeamGap=0, Bridge=True, SeamMode=0, MinLayerTime=35, MaxVolumeRate=330)  # -> Toolpath, Info
startend = StartAndEnd(Toolpath=contpath.Toolpath, SkirtLoops=1, SkirtDistance=0, ExitLength=50, ExitLift=20, ExitFlow=0, Brim=1, BrimLoops=6)  # -> Toolpath, Info

# ---- group: 03. CHECKS
# 03. CHECKS
# Path Check: support, crossings, layer time. Non-Planar Check: bead heights and the head. Move Pose.
check = PathCheck(Toolpath=startend.Toolpath, MaxOffset=0, MinLayerTime=0)  # -> OK, Report, Unsupported, Offset, Crossings, LayerTimes
pose_0_start_1_end = Slider(0.2, range=0..1)
np_check = NonPlanarCheck(Toolpath=startend.Toolpath, TipRadius=4, ConeAngle=30, ConeLength=60, HeadRadius=40, Pose=pose_0_start_1_end)  # -> OK, Report, BeadHeight, BadHeights, Collisions, Head

# ---- group: 05. CALIBRATION
# 05. CALIBRATION
# Print a test wall, measure the bead width, enter it here. Use New Factor as Extrusion Factor on Machine.
factor = MaterialFactor(TargetWidth=4, CurrentFactor=0.21)  # -> NewFactor, Report, Off, Mean

# ---- group: 04. G-CODE FOR THE GINGER ONE
# 04. G-CODE FOR THE GINGER ONE
# Machine 0: Ginger Additive · Ginger One (Marlin). Click 'Save G-code'.
machine = Machine(Machine=0, Save=False)  # -> Machine, Definition, Info, Model
part_name = Panel("Head")
g_code = MachineGCode(Toolpath=startend.Toolpath, Machine=machine.Machine, Name=part_name, Save=False)  # -> GCode, Info, FileName
